# Requirement set req (R2020a)

Attributes:
- req_id: value from Excel

## 1 [req!Sheet1] References to req.xlsx (Sheet1) (Container)
Read-only references to Microsoft Excel document.

### 1.1 [$A2] Trun on LEDs
If the led state is off, turn on each LED with it's related local pole. But if it's already turned on then it should not change
req_id: R1

### 1.2 [$A3] Trun off LEDs
If the led state is on turn off each LED with it's related local pole. But if it's already turned off then it should not change
req_id: R1.1

### 1.3 [$A4] Send state based on device selector
Each slave should send their states to the master periodically if their device selector is on
req_id: R2

### 1.4 [$A5] Trun on a slave device selector
Master trun on a slave device selector and trun off the others
req_id: R3

### 1.5 [$A6] Turn off other slaves
When a slave is selected, the others should be turned off
req_id: R3.1

### 1.6 [$A7] Trun on LEDs from master
Master can trun on the leds of the slave that it's device selector is on. if it's already turned on then it should not change
req_id: R4

### 1.7 [$A8] Trun off LEDs from master
Master can trun off the leds of the slave that it's device selector is on. if it's already turned off then it should not change
req_id: R4.1